# Dynamo graph test.dyn (Dynamo 1.3.0.875)

file_path = Filename("C:\Users\Mostapha\Documents\code\ladybug-tools\dynosaur\test.py")
fromPath = FileObject(file_path)  # "File.FromPath"
readText = File.ReadText(fromPath)
watch = Watch(readText)
python_script_from_string = PythonStringNode(script=readText)
watch_2 = Watch(python_script_from_string)
code_block = CodeBlock(x=python_script_from_string) { x[0]; x[1]; }
byPerimeterPoints = Surface.ByPerimeterPoints(code_block.out1)
code_block_2 = CodeBlock { 200; 100; }
byARGB = Color.ByARGB(g=code_block_2.out0, b=code_block_2.out1)
byGeometryColor = Display.Display.ByGeometryColor(byPerimeterPoints, byARGB)
byPoints = Polygon.ByPoints(code_block.out0)
integer_slider = IntegerSlider(2, range=0..23 step 1)
code_block_3 = CodeBlock(x=byPoints, a=integer_slider) { x[a]; }
byPatch = Surface.ByPatch(code_block_3)
